# Dynamo graph DynamoID.dyn (Dynamo 2.0.1.5055)

categories = Categories(index=604)
all_elements_of_category = ElementsOfCategory(Category=categories)
all_elements_in_active_view = ElementsInView()
id = Element.Id(element=all_elements_in_active_view)
code_block = CodeBlock(id=id) { ElementSelector.ByElementId(id); }
watch = Watch(code_block)
uniqueId = Element.UniqueId(element=all_elements_in_active_view)
code_block_2 = CodeBlock(id=uniqueId) { ElementSelector.ByUniqueId(id); }
watch_2 = Watch(code_block_2)
code_block_3 = CodeBlock { "Element ID"; }
setParameterByName = Element.SetParameterByName(element=all_elements_in_active_view, parameterName=code_block_3, value=id)
family_types = FamilyTypes()  # nothing selected
all_elements_of_family_type = ElementsOfFamilyType(Family_Type=family_types)
